% Simulink data dictionary VSEModel.sldd

K_VSE_FILT_TC = Simulink.Parameter(0.05, DataType="double", Min=0.01, Max=1)  % Low-pass filter time constant [s]
K_TIRE_ROLLING_RADIUS = Simulink.Parameter(0.3, DataType="double", Min=0.2, Max=0.5)  % Effective tire rolling radius [m]
K_VSE_MIN_SPEED = Simulink.Parameter(0, DataType="double", Min=0, Max=5)  % Output floor [km/h]
K_VSE_MAX_SPEED = Simulink.Parameter(300, DataType="double", Min=100, Max=400)  % Output ceiling [km/h]
vEgo_kmh = Simulink.Signal(DataType="double")  % Filtered ego-vehicle speed (output of the VSE) [km/h]